# Requirement set predefined requirements (R2023a)
All the Requirements allocated with the RFID Components are defined in this set

## 1 [Readers] TE Mecanique Readers and Caputered requirments (Container)
Reader requirements including:
1 - Functional Requirments
2 - Enviormental Requirments
3 - Performance Requirments
4 - Interface Requirments
5 - Constraints requirements
6 - Enviormental Requirments
Rationale: we follow the tree approach to capture all the component and its requirements

### 1.1 [Functional Requirments] Precise activities, capacities, or functions of system (Informational)
Functional requirements are the fundamental specifications that describe what a system is supposed to do. They define the behaviour of a system, i.e., the specific services that the system should provide to its users

### 1.2 [Enviormental Requirments] Physical, social, or regulatory factors that the system must comply
environmental requirements refer to the conditions under which a system must operate

### 1.3 [Performance Requirments] criteria and expectations for a system to meet for performance, efficiency, and effectiveness

### 1.4 [Interface Requirments] System interaction and communication with external entities

#### 1.4.1 [XGCS491B201 - PNP] 5 pin-1 male connector M12
https://download.schneider-electric.com/files?p_Doc_Ref=NVE88496_EN
Connector end :
PIN Describtion:
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Rationale: One Side M12
Other side Wired for PNP

#### 1.4.2 [XGCS460B201 - CANJ] Deutsch 6-pin Connector
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
#### 1.4.3 [Modbus_RTU_IO_Master] M12 -A coded 5 pin
Connection to IO Master Link (female):
Pin Config:
Sensor end Connection:
Male 5-pin M12 connector, A-coded
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
### 1.5 [Enviormental Requirments] Conditions and considerations for it to function and perform properly